# Grasshopper definition Cylindriucal.gh (Grasshopper 0.9.14)
# plug-ins: Exoskeleton, Kangaroo Components, Weaverbird

# ----
# Irregular Icosahedron
digit_scroller = DigitScroller(Scroller_Digits=12, Scroller_Radix=9, Scroller_Value=18.15)
digit_scroller_2 = DigitScroller(Scroller_Digits=12, Scroller_Radix=4, Scroller_Value=4744.311248)
sph = Sphere(Base=PlaneXY(0, 0, 0), Radius=digit_scroller)
popgeo = PopulateGeometry(Geometry=sph, Count=Slider(12, range=0..100), Seed=digit_scroller_2)  # -> flatten(Population)
facet = FacetDome(Points=popgeo)  # -> Pattern, Dome
wbdual = WeaverbirdsDualGraph(MeshCurves=facet.Pattern, DualMode=0)
wbedges = WeaverbirdsMeshEdges(MeshOrPolylines=wbdual)

# ----
# Regular Icosahedron
wbicosahedron = WeaverbirdsMeshMeshIcosahedron(Plane=PlaneXY(0, 0, 0), Radius=digit_scroller)
wbedges_2 = WeaverbirdsMeshEdges(MeshOrPolylines=wbicosahedron)

# ----
# Wireframe 'verticies'
end = EndPoints(Curve=wbedges)  # -> Start, End
# this is the breroken bit
# get your 6/12 rNDOM, 6/12 CYLINDER CORNER THING GOING
duppt = RemoveDuplicatePts(Points=[end.Start, end.End], Tolerance=0.01)

end_2 = EndPoints(Curve=wbedges)  # -> Start, End
cullpt = CullDuplicates(Points=[end_2.Start, end_2.End], Tolerance=0.1, CullMode=3)  # -> Points, Indices, Valence
line = Line(reverse(simplify(flatten(wbedges))))

# ----
# Make lines into skeleton
digit_scroller_3 = DigitScroller(Scroller_Digits=12, Scroller_Radix=9, Scroller_Value=1.2)
digit_scroller_4 = DigitScroller(Scroller_Digits=12, Scroller_Radix=9, Scroller_Value=0)
digit_scroller_5 = DigitScroller(Scroller_Digits=12, Scroller_Radix=9, Scroller_Value=-8.44)
digit_scroller_6 = DigitScroller(Scroller_Digits=12, Scroller_Radix=9, Scroller_Value=2)
exo = Exoskeleton(
    Lines=line,
    Sides=Slider(4, range=0..20),
    Thickness=digit_scroller_3,
    NodeSize=digit_scroller_5,
    Knuckle=digit_scroller_4,
    Spacing=digit_scroller_6,
    Open=Toggle(True))
list = ValueList({"One": 1, "Two": 2, "Three": 2² - 1, "Four": Sqrt(16)}, selected=[], ListIndex=0, UIMode=1)
list_2 = ValueList({"One": 1, "Two": 2, "Three": 2² - 1, "Four": Sqrt(16)}, selected=[], ListIndex=0, UIMode=1)
wbloop = WeaverbirdsLoopSubdivision(MeshCurves=exo, Level=list_2, SmoothNakedEdges=list)

mcomp = Decompose(Mesh=wbloop)  # -> Vertices, Faces, Colours, Normals

# ----
# Draw random Inner members
number_slider = Slider(6, range=0..12)  # disabled
lng = ListLength(List=duppt)  # disabled
number_slider_2 = Slider(632, range=0..1001)  # disabled
subtraction = Subtraction(A=lng, B=number_slider)  # disabled
pt = ConstructPoint(XCoordinate=0, YCoordinate=0, ZCoordinate=0)  # disabled
reduce = RandomReduce(List=duppt, Reduction=subtraction, Seed=number_slider_2)  # disabled
ln = Line(StartPoint=reduce, EndPoint=pt)  # disabled

# ----
# Circumscribing Cylinder
list_3 = ValueList({"One": 1, "Two": 2, "Three": 2² - 1, "Four": Sqrt(16)}, selected=[], ListIndex=1, UIMode=1)

# ----
# radius in inches
# rays to cylinder corners
slider = Slider(2, range=0..10)
multiplication = Multiplication(A="25.4/2", B=slider)
list_4 = ValueList({"One": 1, "Two": 2, "Three": 2² - 1, "Four": Sqrt(16)}, selected=[], ListIndex=2, UIMode=1)
polygon = Polygon(Plane=PlaneXY(0, 0, 0), Radius=multiplication, Segments=list_4, FilletRadius=0)  # -> Polygon, Length
vec = VectorXYZ(XComponent=0, YComponent=0, ZComponent=multiplication)  # -> Vector, Length
move = Move(Geometry=polygon.Polygon, Motion=vec.Vector)  # -> Geometry, Transform
neg = Negative(Value=vec.Vector)
# structual corner points on cylinder
pcen = PolygonCenter(Polyline=move.Geometry)  # -> CenterV, CenterE
rotate = Rotate(Geometry=move.Geometry, Angle="pi/3", Plane=pcen.CenterV)  # -> Geometry, Transform
move_2 = Move(Geometry=polygon.Polygon, Motion=neg)  # -> Geometry, Transform
explode = Explode(Curve=[move_2.Geometry, rotate.Geometry], Recursive=True)  # -> Segments, flatten(Vertices)

neg_2 = Negative(Value=multiplication)
vec_2 = VectorXYZ(XComponent=0, YComponent=0, ZComponent=neg_2)  # -> Vector, Length
multiplication_2 = Multiplication(A=multiplication, B=list_3)
pln = Plane(vec_2.Vector)
cyl = Cylinder(Base=pln, Radius=multiplication, Length=multiplication_2)

cullpt_2 = CullDuplicates(Points=explode.Vertices, Tolerance=0.1, CullMode=3)  # -> Points, Indices, Valence

pt_2 = Point(cullpt_2.Points)

# ----
# find points on geo that intercect rays from orgin
list_5 = ValueList({"0"}, selected=[], ListIndex=0, UIMode=1)
pt_3 = Point(pt_2)
geo = Geometry(sph)
pt_4 = PointXYZ(XComponent=list_5, YComponent=list_5, ZComponent=list_5, System=PlaneXY(0, 0, 0))
ln_2 = Line(StartPoint=pt_4, EndPoint=pt_3)
blx = BrepLine(Brep=geo, Line=ln_2, LimitToFirst=False)  # -> Curves, simplify(flatten(Points))
cullpt_3 = CullDuplicates(Points=blx.Points, Tolerance=0.1, CullMode=3)  # -> Points, Indices, Valence

cp = ClosestPoint(Point=pt_2, Cloud=cullpt.Points)  # -> ClosestPoint, CPIndex, Distance
pt_5 = Point(flatten(cp.ClosestPoint))
cullpt_4 = CullDuplicates(Points=pt_5, Tolerance=0.1, CullMode=3)  # -> Points, Indices, Valence
cp_2 = ClosestPoint(Point=pt_2, Cloud=mcomp.Vertices)  # -> ClosestPoint, CPIndex, Distance
ln_3 = Line(StartPoint=cullpt_4.Points, EndPoint=pt_2)
cullpt_5 = CullDuplicates(Points=cp_2.ClosestPoint, Tolerance=0.1, CullMode=3)  # -> Points, Indices, Valence

# ----
# Mesh Relaxation
pt_6 = Point(cullpt_5.Points)
mesh = Mesh(wbloop)
digit_scroller_7 = DigitScroller(Scroller_Digits=12, Scroller_Radix=9, Scroller_Value=242)
digit_scroller_8 = DigitScroller(Scroller_Digits=12, Scroller_Radix=9, Scroller_Value=0.6)
digit_scroller_9 = DigitScroller(Scroller_Digits=12, Scroller_Radix=9, Scroller_Value=1)
digit_scroller_10 = DigitScroller(Scroller_Digits=12, Scroller_Radix=9, Scroller_Value=23)
wbedges_3 = MeshEdges(Mesh=mesh)
springs = SpringsFromLine(
    Connection=wbedges_3,
    Stiffness=digit_scroller_7,
    Damping=digit_scroller_9,
    RestLength=digit_scroller_8,
    Cutoff=0,
    CompressionFail=0,
    TensileFail=0,
    Plasticity=digit_scroller_10)
kangaroo = KangarooPhysics(ForceObjects=flatten(springs), AnchorPoints=pt_6, Settings=null, Geometry=mesh, SimulationReset=Toggle(False))  # -> Out, Iterations, ParticlesOut, GeometryOut
timer = Timer(TimerInterval=50, Target=kangaroo)
digit_scroller_11 = DigitScroller(Scroller_Digits=12, Scroller_Radix=9, Scroller_Value=0.46)
mesh_2 = Mesh(kangaroo.GeometryOut)
wbloop_2 = WeaverbirdsLoopSubdivision(MeshCurves=mesh_2, Level=1, SmoothNakedEdges=1)
wbthicken = WeaverbirdsMeshThicken(MeshCurves=wbloop_2, Distance=digit_scroller_11, OffsetType=digit_scroller_11)  # disabled
