# Grasshopper definition Cylindriucal_3_working_untuned.gh (Grasshopper 0.9.14)
# plug-ins: Exoskeleton, Kangaroo Components, Weaverbird

# ----
# Irregular Icosahedron
digit_scroller = DigitScroller(Scroller_Digits=12, Scroller_Radix=9, Scroller_Value=21.15)
digit_scroller_2 = DigitScroller(Scroller_Digits=12, Scroller_Radix=4, Scroller_Value=5144.311248)
sph = Sphere(Base=PlaneXY(0, 0, 0), Radius=digit_scroller)

# ----
# Regular Icosahedron
wbicosahedron = WeaverbirdsMeshMeshIcosahedron(Plane=Plane(origin=(0, 0, 0), x=(0, 0, 1), y=(1, 0, 0)), Radius=digit_scroller)
wbedges = WeaverbirdsMeshEdges(MeshOrPolylines=wbicosahedron)

# ----
# Wireframe 'verticies'
end = EndPoints(Curve=wbedges)  # -> Start, End
# this is the breroken bit
# get your 6/12 rNDOM, 6/12 CYLINDER CORNER THING GOING
duppt = RemoveDuplicatePts(Points=[end.Start, end.End], Tolerance=0.01)

end_2 = EndPoints(Curve=wbedges)  # -> Start, End
cullpt = CullDuplicates(Points=[end_2.Start, end_2.End], Tolerance=0.1, CullMode=3)  # -> Points, Indices, Valence

# ----
# Draw random Inner members
number_slider = Slider(6, range=0..12)  # disabled
lng = ListLength(List=duppt)  # disabled
number_slider_2 = Slider(632, range=0..1001)  # disabled
subtraction = Subtraction(A=lng, B=number_slider)  # disabled
pt = ConstructPoint(XCoordinate=0, YCoordinate=0, ZCoordinate=0)  # disabled
reduce = RandomReduce(List=duppt, Reduction=subtraction, Seed=number_slider_2)  # disabled
ln = Line(StartPoint=reduce, EndPoint=pt)  # disabled

# ----
# Circumscribing Cylinder
list = ValueList({"One": 1, "Two": 2, "Three": 2² - 1, "Four": Sqrt(16)}, selected=[], ListIndex=1, UIMode=1)

# ----
# radius in inches
# rays to cylinder corners
slider = Slider(2, range=0..10)
multiplication = Multiplication(A="25.4/2", B=slider)
list_2 = ValueList({"One": 1, "Two": 2, "Three": 2² - 1, "Four": Sqrt(16)}, selected=[], ListIndex=2, UIMode=1)
polygon = Polygon(Plane=PlaneXY(0, 0, 0), Radius=multiplication, Segments=list_2, FilletRadius=0)  # -> Polygon, Length
vec = VectorXYZ(XComponent=0, YComponent=0, ZComponent=multiplication)  # -> Vector, Length
move = Move(Geometry=polygon.Polygon, Motion=vec.Vector)  # -> Geometry, Transform
neg = Negative(Value=vec.Vector)
# structual corner points on cylinder
pcen = PolygonCenter(Polyline=move.Geometry)  # -> CenterV, CenterE
rotate = Rotate(Geometry=move.Geometry, Angle="pi/3", Plane=pcen.CenterV)  # -> Geometry, Transform
move_2 = Move(Geometry=polygon.Polygon, Motion=neg)  # -> Geometry, Transform

neg_2 = Negative(Value=multiplication)
vec_2 = VectorXYZ(XComponent=0, YComponent=0, ZComponent=neg_2)  # -> Vector, Length
pln = Plane(vec_2.Vector)
multiplication_2 = Multiplication(A=multiplication, B=list)
cyl = Cylinder(Base=pln, Radius=multiplication, Length=multiplication_2)

crv = Curve([move_2.Geometry, rotate.Geometry])
rotate_2 = Rotate(Geometry=crv, Angle="pi/6", Plane=PlaneXY(0, 0, 0))  # -> Geometry, Transform
crv_2 = Curve(rotate_2.Geometry)

# ----
# find points on geo that intercect rays from orgin
list_3 = ValueList({"0"}, selected=[], ListIndex=0, UIMode=1)
geo = Geometry(sph)
pt_2 = PointXYZ(XComponent=list_3, YComponent=list_3, ZComponent=list_3, System=PlaneXY(0, 0, 0))

explode = Explode(Curve=crv_2, Recursive=True)  # -> flatten(Segments), flatten(Vertices)

cullpt_2 = CullDuplicates(Points=explode.Vertices, Tolerance=0.1, CullMode=3)  # -> Points, Indices, Valence

pt_3 = Point(cullpt_2.Points)

pt_4 = Point(pt_3)
ln_2 = Line(StartPoint=pt_2, EndPoint=pt_4)
blx = BrepLine(Brep=geo, Line=ln_2, LimitToFirst=False)  # -> Curves, simplify(flatten(Points))
cullpt_3 = CullDuplicates(Points=blx.Points, Tolerance=0.1, CullMode=3)  # -> Points, Indices, Valence

popgeo = PopulateGeometry(Geometry=sph, Count=Slider(12, range=0..100), Seed=digit_scroller_2, Points=cullpt_3.Points)  # -> flatten(Population)
facet = FacetDome(Points=popgeo)  # -> Pattern, Dome
wbdual = WeaverbirdsDualGraph(MeshCurves=facet.Pattern, DualMode=0)
wbedges_2 = WeaverbirdsMeshEdges(MeshOrPolylines=wbdual)

line = Line(explode.Segments)
cp = ClosestPoint(Point=pt_3, Cloud=cullpt.Points)  # -> ClosestPoint, CPIndex, Distance
pt_5 = Point(flatten(cp.ClosestPoint))
cullpt_4 = CullDuplicates(Points=pt_5, Tolerance=0.1, CullMode=3)  # -> Points, Indices, Valence
ln_3 = Line(StartPoint=cullpt_4.Points, EndPoint=pt_3)
line_2 = Line(reverse(simplify(flatten([ln_3, wbedges]))))

# ----
# Make lines into skeleton
digit_scroller_3 = DigitScroller(Scroller_Digits=12, Scroller_Radix=9, Scroller_Value=0.288)
digit_scroller_4 = DigitScroller(Scroller_Digits=12, Scroller_Radix=9, Scroller_Value=1)
digit_scroller_5 = DigitScroller(Scroller_Digits=12, Scroller_Radix=9, Scroller_Value=0)
digit_scroller_6 = DigitScroller(Scroller_Digits=12, Scroller_Radix=9, Scroller_Value=5)
exo = Exoskeleton(
    Lines=line_2,
    Sides=Slider(5, range=0..20),
    Thickness=digit_scroller_3,
    NodeSize=digit_scroller_4,
    Knuckle=digit_scroller_5,
    Spacing=digit_scroller_6,
    Open=Toggle(False))
list_4 = ValueList({"One": 1, "Two": 2, "Three": 2² - 1, "Four": Sqrt(16)}, selected=[], ListIndex=0, UIMode=1)
list_5 = ValueList({"One": 1, "Two": 2, "Three": 2² - 1, "Four": Sqrt(16)}, selected=[], ListIndex=0, UIMode=1)
wbloop = WeaverbirdsLoopSubdivision(MeshCurves=exo, Level=list_5, SmoothNakedEdges=list_4)

mcomp = Decompose(Mesh=wbloop)  # -> Vertices, Faces, Colours, Normals
cp_2 = ClosestPoint(Point=duppt, Cloud=mcomp.Vertices)  # -> ClosestPoint, CPIndex, Distance
cp_3 = ClosestPoint(Point=pt_3, Cloud=cp_2.ClosestPoint)  # -> ClosestPoint, CPIndex, Distance
cp_4 = ClosestPoint(Point=pt_3, Cloud=mcomp.Vertices)  # -> ClosestPoint, CPIndex, Distance
cull_i = CullIndex(List=cp_2.ClosestPoint, Indices=cp_3.CPIndex, Wrap=False)
cullpt_5 = CullDuplicates(Points=cp_2.ClosestPoint, Tolerance=0.1, CullMode=3)  # -> Points, Indices, Valence
wbjoin = WeaverbirdsJoinMeshesAndWeld(Mesh=wbloop, Weld=False)

# ----
# Mesh Relaxation
mesh = Mesh(wbjoin)
digit_scroller_7 = DigitScroller(Scroller_Digits=12, Scroller_Radix=9, Scroller_Value=132)
digit_scroller_8 = DigitScroller(Scroller_Digits=12, Scroller_Radix=9, Scroller_Value=1)
digit_scroller_9 = DigitScroller(Scroller_Digits=12, Scroller_Radix=9, Scroller_Value=0.6)
digit_scroller_10 = DigitScroller(Scroller_Digits=12, Scroller_Radix=9, Scroller_Value=53)
pt_6 = Point(flatten([cull_i, cp_4.ClosestPoint]))
wbedges_3 = MeshEdges(Mesh=mesh)
springs = SpringsFromLine(
    Connection=wbedges_3,
    Stiffness=digit_scroller_7,
    Damping=digit_scroller_8,
    RestLength=digit_scroller_9,
    Cutoff=0,
    CompressionFail=0,
    TensileFail=0,
    Plasticity=digit_scroller_10)
kangaroo = KangarooPhysics(ForceObjects=flatten(springs), AnchorPoints=pt_6, Settings=null, Geometry=mesh, SimulationReset=Toggle(False))  # -> Out, Iterations, ParticlesOut, GeometryOut
timer = Timer(TimerInterval=50, Target=kangaroo)
digit_scroller_11 = DigitScroller(Scroller_Digits=12, Scroller_Radix=9, Scroller_Value=0.46)
mesh_2 = Mesh(kangaroo.GeometryOut)
wbloop_2 = WeaverbirdsLoopSubdivision(MeshCurves=mesh_2, Level=1, SmoothNakedEdges=1)
wbthicken = WeaverbirdsMeshThicken(MeshCurves=wbloop_2, Distance=digit_scroller_11, OffsetType=digit_scroller_11)  # disabled

volume = Volume(Geometry=wbjoin)  # -> Volume, Centroid
panel = Panel(volume.Volume)
